# Dynamo graph interop-excel.dyn (Dynamo 1.3.2.2480)

excel = Python()  # unwired: IN[0]
# ---------- excel.python (25 lines) ----------
import clr,System
clr.AddReference('Microsoft.Office.Interop.Excel')

import Microsoft.Office.Interop.Excel as Excel
from System.Runtime.InteropServices import Marshal
System.Threading.Thread.CurrentThread.CurrentCulture = System.Globalization.CultureInfo("en-US")

"""
# active excel doc
try:
	excel = Marshal.GetActiveObject("Excel.Application")
except:
	excel = "no active excel docs"
OUT = excel
"""

# excel app
excel = Excel.ApplicationClass()
# open workbook
workbook = excel.Workbooks.Open(r"C:\Users\min.naung\Desktop\wb1.xlsx")

# adding a new worksheet
#worksheet = workbook.Worksheets.Add()

OUT = workbook
# ----------------------------------------
watch = Watch(excel)
